# Grasshopper definition 20200808_RhinoInsideWorkshop.gh (Grasshopper 1.0.7)
# plug-ins: Rhino.Inside for Autodesk Revit, Pufferfish

gallery = ImageGallery(CycleDelay=30, Randomize=False, UseLocalImages=True, UseRemoteImages=True)
panel = Panel("RhinoからRevitの壁を作る")
graphical_element = GraphicalElement([<familyinstance referenced from the Revit model> x3])
# 1-1．Revitのジオメトリ読み込む
graphical_element_2 = GraphicalElement(<wall referenced from the Revit model>)
crv = Curve(<curve referenced from the Rhino model>)
# 01．複数のレベルをつくる
model = ModelCategoriesPicker({"HVAC ゾーン": -2008107, "MEP 製造用ダクト部品": -2008193, "MEP 製造用ハンガー部品": -2008203, "MEP 製造用収納部品": -2008212, "MEP 製造用配管部品": -2008208, "RVT リンク": -2001352, "エリア": -2003200, "カーテン グリッド": -2000173, "カーテン システム": -2000340, "カーテン パネル": -2000170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}, selected="壁": -2000011)

number_slider = Slider(10, range=0..100)
number_slider_2 = Slider(5000, range=0..10000)
# 02．指定のレベルを消す
設計gl = Slider(500, range=0..1000)

viewtypes = QueryViewTypes()

bbox = BoundingBox(Content=graphical_element, Plane=PlaneXY(0, 0, 0), UnionBox=False)  # -> Box, Box_2
X = UnitX(Factor=Slider(813, range=0..1000))
move = Move(Geometry=bbox.Box, Motion=X)  # -> Geometry, Transform

# ----
# 03．平面図をつくる
panel_2 = Panel("Revit側で操作する。現在CreateViewはGHのコンポーネントがない。まだバグがってAPIからつくるとRevitが落ちる")

elemcat = ElementCategory(Element=graphical_element_2)  # -> Element, Category
panel_3 = Panel(elemcat.Category)

geometry = ElementGeometry(Elements=graphical_element_2)
bbox_2 = BoundingBox(Content=geometry, Plane=PlaneXY(0, 0, 0), UnionBox=True)  # -> Box, Box_2
debrep = DeconstructBrep(Brep=bbox_2.Box)  # -> Faces, Edges, Vertices
item = ListItem(List=debrep.Faces, Index=1, Wrap=True)

# ----
# 04．マスから壁をつくる
# 全てのレベルを取得する
document_levels = DocumentLevels()

# ----
# With C#
# Manage one data-stream
# (wall curves)
value_set_picker = ValueSetPicker(viewtypes)

# ----
# Get elevations of levels
# from Revit document
document_levels_2 = DocumentLevels()
panel_5 = Panel("Elevation")
get_element_parameter = GetElementParameter(Element=document_levels_2, ParameterKey="高さ")
level_elevations_no_need_to_sort = Number(get_element_parameter)

level = LevelsPicker({"レベル10": 209964, "レベル9": 209963, "レベル8": 209962, "レベル7": 209961, "レベル6": 209960, "レベル5": 209959, "レベル4": 209958, "レベル3": 209957, "レベル2": 209956, "レベル1": 209955, "設計GL": 209954}, selected="レベル10")
levels = QueryLevels()
level_2 = Level(levels)
dam = DataDam(DataA=level_2, BufferDelay=10000000, BufferMode=0)
delete = DeleteElement(Elements=dam)

elementtype_picker = ElementTypePicker(
    model,
    {"カーテンウォール : カーテンウォール": 22905, "カーテンウォール : ショーウィンドウ": 50936, "カーテンウォール : 外部ガラス": 50935, "標準壁 : エクステリア - メタル スタッドのブロック": 75447, "標準壁 : 一般 - 150 mm": 219, "標準壁 : 一般 - 150 mm 組積造": 255, "標準壁 : 一般 - 200 mm": 249, "標準壁 : 一般 - 200 mm - 塗り潰し": 40342, "標準壁 : 一般 - 200 mm CMU": 254, "標準壁 : 一般 - 250 mm": 250, "標準壁 : 一般 - 300 mm": 251, "標準壁 : 一般 - 300 mm 組積造": 253, "標準壁 : 一般 - 375 mm": 252, "標準壁 : 一般 - 90 mm レンガ": 257, "標準壁 : 内壁 - 123 mm 間仕切り(1時間)": 261, "標準壁 : 内壁 - 126 mm 間仕切り(2時間)": 263, "標準壁 : 内壁 - 135 mm 間仕切り(2時間)": 262, "標準壁 : 内壁 - 138 mm 間仕切り(1時間)": 220, "標準壁 : 内壁 - 79 mm 間仕切り(1時間)": 258, "標準壁 : 基礎 - 300 mm コンクリート": 31000, "標準壁 : 外壁 - CMU のレンガ": 264, "標準壁 : 外壁 - メタル スタッドの EIFS": 256, "標準壁 : 外壁 - メタル スタッドのレンガ": 75445, "標準壁 : 外部 - ブロック上のレンガ、メタル スタッドで固定": 221, "標準壁 : 擁壁 - 300 mm コンクリート": 31001}, selected="標準壁 : 一般 - 200 mm")

# ----
# 高さに応じて並び変え
levels_from_revit = Level(document_levels)
levels_from_revit_2 = Level(levels_from_revit)
getpara = GetElementParameter(Element=levels_from_revit, ParameterKey="高さ")
levels_from_revit_3 = Level(levels_from_revit_2)
sort = SortList(Keys=getpara, ValuesA=levels_from_revit_3)  # -> Keys, ValuesA

panel_6 = Panel(levels_from_revit)

# ----
# Color Format
# Input
data = Data(1)
# Method
data_2 = Data(1)
# Output
data_3 = Data(1)
# Display
data_4 = Data(1)
# Unuse
data_5 = Data(1)

offcrv = OffsetCurve(Curve=item, Plane=PlaneXY(0, 0, 0), Distance=expr("-x", Slider(805, range=0..1000)), BothSides=False, Kinks=0, CapType=1)

toggle = BooleanToggle(False)
level_3 = DocumentLevelsPicker({"レベル10": 209964, "レベル9": 209963, "レベル8": 209962, "レベル7": 209961, "レベル6": 209960, "レベル5": 209959, "レベル4": 209958, "レベル3": 209957, "レベル2": 209956, "レベル1": 209955, "設計GL": 209954}, selected="レベル10")
categorytypes = CategoryTypes({"Model": 1, "Annotation": 2, "Internal": 4, "Analytical": 5}, selected="Model")
revit_c_script = RevitCSharpScript(Reference=["C:\Program Files\Autodesk\Revit 2020\RevitAPI.dll", "C:\Program Files\Autodesk\Revit 2020\RevitAPIUI.dll", "C:\Users\ykish\AppData\Roaming\Autodesk\Revit\Addins\2020\RhinoInside.Revit\RhinoInside.Revit.dll"])  # -> out, ViewPlan
# ---------- revit_c_script: C# usings ----------
using RIR = RhinoInside.Revit;
using DB = Autodesk.Revit.DB;
using UI = Autodesk.Revit.UI;
# ---------- end revit_c_script ----------
model_2 = ModelCategoriesPicker({"HVAC ゾーン": -2008107, "MEP 製造用ダクト部品": -2008193, "MEP 製造用ハンガー部品": -2008203, "MEP 製造用収納部品": -2008212, "MEP 製造用配管部品": -2008208, "RVT リンク": -2001352, "エリア": -2003200, "カーテン グリッド": -2000173, "カーテン システム": -2000340, "カーテン パネル": -2000170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}, selected="スペース": -2003600)
level_4 = LevelsPicker({"レベル10": 209964, "レベル9": 209963, "レベル8": 209962, "レベル7": 209961, "レベル6": 209960, "レベル5": 209959, "レベル4": 209958, "レベル3": 209957, "レベル2": 209956, "レベル1": 209955, "設計GL": 209954}, selected="レベル10")

area = Area(Geometry=item)  # -> Area, Centroid
evalsrf = EvaluateSurface(Surface=item, Point=area.Centroid)  # -> Point, Normal, UDirection, VDirection, Frame

pop2d = Populate2D(Region=offcrv, Count=100, Seed=1)

dom = ConstructDomain(DomainStart=Slider(0, range=0..100), DomainEnd=Slider(300, range=0..1000))
lng = ListLength(List=pop2d)
random = Random(Range=dom, Number=lng, Seed=2)
amp = Amplitude(Vector=evalsrf.Normal, Amplitude=random)

wall = AddWall(Curve=crv, Type=elementtype_picker, Level=level_3, Height=Slider(2080, range=0..10000))
elementtype_picker_2 = ElementTypePicker(categorytypes)
panel_7 = Panel(categorytypes)

# ----
# CUT RHINO GEOMETRY TO GET CURVES
# FOR EXTERIOR WALLS
pipeline = GeometryPipeline(
    GroupByLayer=False,
    GroupByType=False,
    IncludeHidden=True,
    IncludeLocked=True,
    LayerFilter="DESIGN OPTIONS::TEMPLATE::3D::Residential",
    NameFilter="*",
    SublayerFiltering=True,
    TypeFilter=1073741848)
level_elevations_no_need_to_sort_2 = Number(level_elevations_no_need_to_sort)
construct_point = ConstructPoint(XCoordinate=0, YCoordinate=0, ZCoordinate=level_elevations_no_need_to_sort_2)
xy_plane = XYPlane(Origin=construct_point)
rhino_massing_to_cut_up = Brep(pipeline)
floor_cutting_planes = Plane(xy_plane)
sec = BrepPlane(Brep=flatten(rhino_massing_to_cut_up), Plane=simplify(graft(floor_cutting_planes)))  # -> Curves, Points
path_mapper = PathMapper(sec.Curves, source="{A;B}", target="{A}")
perimeter_curves_from_breps_closed = Curve(path_mapper)

levels_from_revit_4 = Level(sort.ValuesA)

len = Length(Curve=item)
division = Division(A=len, B=Slider(2000, range=0..10000))
int = Integer(division)

geometry_2 = ElementGeometry(Elements=wall)

xy = XYPlane(Origin=Point(0, 0, 0))
level_elevations_sorted = Number(sort.Keys)
pl_offset = PlaneOffset(BasePlane=xy, Offset=level_elevations_sorted)

item_2 = ListItem(List=geometry_2, Index=Slider(0, range=0..10), Wrap=True)

# ----
# レベルの情報を用いて階高の算出。階高から壁の高さを指定する
level_elevations_sorted_2 = Number(level_elevations_sorted)
graft = GraftTree(Tree=level_elevations_sorted_2, IncludeEmptyLists=True, IncludeNullItems=True)  # -> simplify(Tree)
shift = ShiftList(List=level_elevations_sorted_2, Shift=1, Wrap=False)  # -> simplify(graft(List))
floor_x = Number(graft)
floor_x_1 = Number(shift)
subtraction = Subtraction(A=floor_x_1, B=floor_x)
shift_2 = ShiftList(List=flatten(subtraction), Shift="-1", Wrap=False)  # -> graft(List)
distances_btwn_levels = Number(shift_2)

panel_8 = Panel(pl_offset)

levels_from_revit_sorted = Level(levels_from_revit_4)
shift_3 = ShiftList(List=flatten(levels_from_revit_sorted), Shift="-1", Wrap=False)  # -> simplify(graft(List))
levels_from_revit_except_final = Level(shift_3)

# ----
# カット用のPlaneをつくる
xy_2 = XYPlane(Origin=Point(0, 0, 0))
level_elevations_sorted_3 = Number(level_elevations_sorted)
pl_offset_2 = PlaneOffset(BasePlane=xy_2, Offset=level_elevations_sorted_3)
shift_4 = ShiftList(List=flatten(pl_offset_2), Shift="-1", Wrap=False)  # -> graft(List)
level_planes_sorted = Plane(shift_4)

pln = Plane(pl_offset)

move_2 = Move(Geometry=pop2d, Motion=amp)  # -> Geometry, Transform
divide = DivideCurve(Curve=item, Count=int, Kinks=False)  # -> Points, Tangents, Parameters
merge = Merge(Data1=flatten(move_2.Geometry), Data2=flatten(divide.Points))

mesh = MeshBrep(
    Brep=move.Geometry,
    Settings={GridMaxCount=0, GridMinCount=16, JaggedSeams=False, MaxEdgeLength=0, MinEdgeLength=0.0001, MinTolerance=0, Refine=True, RefineAngle=0, RelativeTolerance=0.65, SimplePlanes=True, Tolerance=0})
mjoin = MeshJoin(Meshes=mesh)

del = DelaunayMesh(Points=merge, Plane=evalsrf.Frame)

pipeline_2 = GeometryPipeline(
    GroupByLayer=False,
    GroupByType=False,
    IncludeHidden=True,
    IncludeLocked=True,
    LayerFilter="Volume",
    NameFilter="*",
    SublayerFiltering=True,
    TypeFilter=1073741848)
level_planes_sorted_2 = Plane(level_planes_sorted)
brep = Brep(pipeline_2)
sec_2 = BrepPlane(Brep=flatten(brep), Plane=simplify(graft(level_planes_sorted_2)))  # -> Curves, Points
path_mapper_2 = PathMapper(sec_2.Curves, source="{A;B}", target="{A}")
perimeter_curves_from_breps_closed_2 = Curve(path_mapper_2)

# ----
# 1-2．ジオメトリをRevit返す
msplit = MeshSplit(Mesh=del, Splitters=mjoin)
item_3 = ListItem(List=msplit, Index=0, Wrap=True)
dam_2 = DataDam(DataA=item_3, BufferDelay=10000000, BufferMode=0)
mshdshape = AddMeshDirectShape(Mesh=dam_2)

panel_9 = Panel(levels_from_revit_except_final)
panel_10 = Panel(distances_btwn_levels)

perimeter_curves_from_breps_closed_3 = Curve(perimeter_curves_from_breps_closed)
revitc2019_c_script = RevitCSharpScript(
    curve=perimeter_curves_from_breps_closed_3,
    Reference=["C:\Program Files\Autodesk\Revit 2020\RevitAPI.dll", "C:\Program Files\Autodesk\Revit 2020\RevitAPIUI.dll", "C:\USERS\YKISH\APPDATA\ROAMING\AUTODESK\REVIT\ADDINS\2020\RHINOINSIDE.REVIT\RhinoInside.Revit.dll"])  # -> out, closestLevelPerCurve, closestLevelPerCurveName, closestLevelPerCurveID, curveIsOnLevel, levelAbovePerCurve, levelAbovePerCurveName, levelAbovePerCurveID, heightToLevelAbove; inputs curve: Curve, optFinalFloorHeight: Double
# ---------- revitc2019_c_script: C# usings ----------
using RIR = RhinoInside.Revit;
using Autodesk;
using DB = Autodesk.Revit.DB;
using UI = Autodesk.Revit.UI;
using System.Linq;
# ---------- revitc2019_c_script: C# ----------
    //Create a string buffer to avoid tree issues on OUT endpoint
    string printOutputBuffer = "";


    //Check curve planarity (they need to be planar to work with Revit walls anyway)
    if (curve == null){
      printOutputBuffer += "Error: Curve is null. ";
      //Execution of this iteration is about to end, so Print() the printbuffer first
      Print(printOutputBuffer);
      return;
    }


    //Check curve planarity (they need to be planar to work with Revit walls anyway)
    if (!curve.IsPlanar()){
      printOutputBuffer += "Error: Curve is not planar. ";
      //Execution of this iteration is about to end, so Print() the printbuffer first
      Print(printOutputBuffer);
      return;
    }


    //The curve is planar, assume that it is planar in XY plane.. get Z value of curve's startpoint
    double curveElevation = curve.PointAtStart.Z;
    DB.Level curveClosestLevel = FindClosestLevel(curveElevation);
    bool curveLevelMatch = RhinoMath.EpsilonEquals(curveElevation, curveClosestLevel.Elevation, RhinoDocument.ModelAbsoluteTolerance * 4);


    //Start by assuming that there is a level above the curve's level, then look for it and update the flag if the assumption is incorrect
    bool levelAboveExists = true;
    DB.Level nextLevel = FindNextLevel(curveClosestLevel);

    if(nextLevel == null) {
      //This does not break the iteration, because the final level can just use a default value.
      levelAboveExists = false;
      printOutputBuffer += "No level found above. ";
    }

    //Set a DefaultFloorHeight based on what the active units are
    double defaultFloorHeight = 0;

    string modelUnit = Rhino.RhinoDoc.ActiveDoc.GetUnitSystemName(true, false, false, false);
    switch(modelUnit)
    {
      case "inches":
        defaultFloorHeight = 48;
        break;
      case "feet":
        defaultFloorHeight = 4;
        break;
      default:
        printOutputBuffer += "Error, document unit is not feet or inches, it is: " + modelUnit + ". ";
        Print(printOutputBuffer);
        return;
    }


    //Override the DefaultFloorHeight if the user has specified a different one
    if (optFinalFloorHeight > 0){
      defaultFloorHeight = optFinalFloorHeight;
    }
    else
    {
      printOutputBuffer += "Invalid height (0 or less) provided for final floor, default value of " + defaultFloorHeight + " " + modelUnit + " will be used instead. ";
    }


    //If there is a level above the current level, calculate distance to it, otherwise, provide default height
    double distToNextLevel = 0;

    if(levelAboveExists){
      distToNextLevel = nextLevel.Elevation - curveClosestLevel.Elevation;
    }
    else{
      distToNextLevel = defaultFloorHeight;
    }


    //set all the ouput values
    closestLevelPerCurve = curveClosestLevel;
    closestLevelPerCurveName = curveClosestLevel.Name;
    closestLevelPerCurveID = curveClosestLevel.Id;
    curveIsOnLevel = curveLevelMatch;

    if (levelAboveExists){
      levelAbovePerCurve = nextLevel;
      levelAbovePerCurveName = nextLevel.Name;
      levelAbovePerCurveID = nextLevel.Id;

    }
    else{
      levelAbovePerCurve = "null";
      levelAbovePerCurveName = "null";
      levelAbovePerCurveID = "null";
    }

    heightToLevelAbove = distToNextLevel;
# ---------- revitc2019_c_script: C# additional code ----------
  public Dictionary<int, DB.Level> AllLevels = new Dictionary<int, DB.Level>();
  public DB.Document CurrentRevitDoc = null;

  public IOrderedEnumerable<DB.Level> FindAndSortLevels(DB.Document doc)
  {
    return new DB.FilteredElementCollector(doc)
      .WherePasses(new DB.ElementClassFilter(typeof(DB.Level), false))
      .Cast<DB.Level>()
      .OrderBy(e => e.Elevation);
  }

  //public DB.Level FindLevel(){}

  public DB.Level FindClosestLevel(double inputElevation){

    double tolerance = RhinoDocument.ModelAbsoluteTolerance * 4;

    var minDistance = AllLevels.Min(kvp => Math.Abs(inputElevation - kvp.Value.Elevation));
    var closest = AllLevels.First(kvp => RhinoMath.EpsilonEquals(Math.Abs(inputElevation - kvp.Value.Elevation), minDistance, tolerance));

    return closest.Value;
  }


  public DB.Level FindNextLevel(DB.Level level){

    DB.Level levelBuffer = null;

    for (int i = 0; i < AllLevels.Count; i++){
      if(AllLevels[i].Elevation == level.Elevation){

        if(AllLevels.TryGetValue(i + 1, out levelBuffer)){
          levelBuffer = AllLevels[i + 1];
        }
      }
    }

    return levelBuffer;
  }


  /// <summary>
  /// This method will be called once every solution, before any calls to RunScript.
  /// </summary>
  public override void BeforeRunScript()
  {
    AllLevels.Clear();
    CurrentRevitDoc = RIR.Revit.ActiveDBDocument;

    IOrderedEnumerable<DB.Level> levelsBuffer = FindAndSortLevels(CurrentRevitDoc);

    int i = 0;

    foreach (DB.Level level in levelsBuffer){
      AllLevels.Add(i, level);
      i++;
    }


  }
  /// <summary>
  /// This method will be called once every solution, after any calls to RunScript.
  /// </summary>
  public override void AfterRunScript()
  { }
# ---------- end revitc2019_c_script ----------
perimeter_curves_from_breps_closed_4 = Curve(perimeter_curves_from_breps_closed_3)
revit_levels_closest_to_curves = Level(revitc2019_c_script.closestLevelPerCurve)

pshift = ShiftPaths(Data=sec_2.Curves, Offset=-1)
panel_11 = Panel(perimeter_curves_from_breps_closed_2)

perimeter_curves_from_breps = Curve(perimeter_curves_from_breps_closed_2)
explode = Explode(Curve=perimeter_curves_from_breps, Recursive=True)  # -> Segments, Vertices
trim = TrimTree(Tree=explode.Segments, Depth=1)
atomic_wall_curves = Curve(trim)

perimeter_curves_from_breps_2 = Curve(perimeter_curves_from_breps_closed_2)
distances_btwn_levels_2 = Number(distances_btwn_levels)
levels_from_revit_except_final_2 = Level(levels_from_revit_except_final)
data_dam = DataDam(
    DataDataA=perimeter_curves_from_breps_closed_4,
    DataDataB=revit_levels_closest_to_curves,
    BufferDelay=10000000,
    BufferMode=0)  # -> DataDataA, DataDataB

perimeter_curves_from_breps_3 = Curve(data_dam.DataDataA)
levels_from_revit_except_final_3 = Level(data_dam.DataDataB)
type = Type()
add_floor = AddFloor(Boundary=perimeter_curves_from_breps_3, Type=type, Level=levels_from_revit_except_final_3)  # -> flatten(Floor)

# ----
# Execute Revit API Call
atomic_wall_curves_2 = Curve(atomic_wall_curves)
distances_btwn_levels_3 = Number(distances_btwn_levels_2)
T = Type()
levels_from_revit_except_final_4 = Level(levels_from_revit_except_final_2)
wall_2 = AddWall(
    Curve=atomic_wall_curves_2,
    Type=T,
    Level=levels_from_revit_except_final_4,
    Height=distances_btwn_levels_3,
    AllowJoins=Toggle(True))  # -> flatten(Wall)

perimeter_curves_from_breps_4 = Curve(perimeter_curves_from_breps_2)
levels_from_revit_except_final_5 = Level(levels_from_revit_except_final_2)
type_2 = Type()
floor = AddFloor(Boundary=perimeter_curves_from_breps_4, Type=type_2, Level=levels_from_revit_except_final_5)  # -> flatten(Floor)

series = Series(Start=number_slider_2, Step=number_slider_2, Count=number_slider)
neg = Negative(Value=設計gl)
series_2 = Series(Start=1, Step=1, Count=number_slider)
concat = Concatenate(FragmentA="レベル", FragmentB=series_2)
merge_2 = Merge(Data1=flatten(neg), Data2=flatten(series))
merge_3 = Merge(Data1=flatten("設計GL"), Data2=flatten(concat))
panel_12 = Panel(merge_3)

dam_3 = DataDam(DataA=merge_2, BufferDelay=10000000, BufferMode=0)

level_5 = AddLevel(Elevation=dam_3, Name=merge_3)

# ----
# C# Node:
# 1. Find the level closest to each curve
# 2A. Find the level above (to calculate wall height)
# 2B. Use default height for last level
# LET C# DO ALL THE COORDINATING
perimeter_curves_from_breps_closed_5 = Curve(perimeter_curves_from_breps_closed)

explode_2 = Explode(Curve=perimeter_curves_from_breps_closed_5, Recursive=True)  # -> Segments, Vertices

revitc2019_c_script_2 = RevitCSharpScript(
    curve=explode_2.Segments,
    optFinalFloorHeight="4",
    Reference=["C:\Program Files\Autodesk\Revit 2020\RevitAPI.dll", "C:\Program Files\Autodesk\Revit 2020\RevitAPIUI.dll", "C:\USERS\YKISH\APPDATA\ROAMING\AUTODESK\REVIT\ADDINS\2020\RHINOINSIDE.REVIT\RhinoInside.Revit.dll"])  # -> out, closestLevelPerCurve, closestLevelPerCurveName, closestLevelPerCurveID, curveIsOnLevel, levelAbovePerCurve, levelAbovePerCurveName, levelAbovePerCurveID, heightToLevelAbove; inputs curve: Curve, optFinalFloorHeight: Double; same code as revitc2019_c_script
revit_levels_closest_to_curves_2 = Level(revitc2019_c_script_2.closestLevelPerCurve)
level_above_per_curve = Element(revitc2019_c_script_2.levelAbovePerCurve)
distances_btwn_levels_4 = Number(revitc2019_c_script_2.heightToLevelAbove)
atomic_wall_curves_3 = Curve(explode_2.Segments)

data_dam_2 = DataDam(
    DataDataA=atomic_wall_curves_3,
    DataDataB=revit_levels_closest_to_curves_2,
    DataDataC=level_above_per_curve,
    DataDataD=distances_btwn_levels_4,
    BufferDelay=10000000,
    BufferMode=0)  # -> DataDataA, DataDataB, DataDataC, DataDataD

T_2 = Type()
# Execute Revit API Call
atomic_wall_curves_4 = Curve(data_dam_2.DataDataA)
distances_btwn_levels_5 = Number(data_dam_2.DataDataC)
revit_levels_closest_to_curves_3 = Level(data_dam_2.DataDataB)
wall_3 = AddWall(
    Curve=atomic_wall_curves_4,
    Type=T_2,
    Level=revit_levels_closest_to_curves_3,
    Height=distances_btwn_levels_5,
    AllowJoins=Toggle(True))  # -> flatten(Wall)

level_above_per_curve_2 = Element(data_dam_2.DataDataD)
data_dam_3 = DataDam(DataDataA=wall_3, DataDataB=level_above_per_curve_2, BufferDelay=10000000, BufferMode=0)  # -> DataDataA, DataDataB

# ----
# Constrain top of wall to level above
wall_element = Element(data_dam_3.DataDataA)
level_above_per_curve_3 = Element(data_dam_3.DataDataB)
builtinparametergroups = BuiltInParameterGroups({"": -5000156, "": -5000155, "": -5000154, "Adaptive Component": -5000172, "Advanced": -5000217, "Analysis Results": -5000161, "Analytical Alignment": -5000191, "Analytical Model": -5000145, "Analytical Properties": -5000192, "Area": -5000166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}, selected="Constraints": -5000119)
clean_tree = CleanTree(RemoveNulls=True, RemoveInvalid=True, RemoveEmpty=False, Tree=wall_element)
list_item = ListItem(List=flatten(clean_tree), Index=0, Wrap=True)
element_parameters = ElementParameters(Element=list_item, Name="Top Constraint", Group=builtinparametergroups)
set_element_parameter = SetElementParameter(Element=wall_element, ParameterKey=element_parameters, ParameterValue=level_above_per_curve_3)
