# Grasshopper definition 01_MakeGeometry.gh (Grasshopper 1.0.7)
# plug-ins: EleFront, Rhino.Inside for Autodesk Revit

gallery = ImageGallery(CycleDelay=30, Randomize=False, UseLocalImages=True, UseRemoteImages=True)

number_slider = Slider(20, range=0..100)
series = Series(Start=0, Step=Slider(4200, range=0..10000), Count=number_slider)

num = Number(series)

series_2 = Series(Start=1, Step=1, Count=number_slider)
num_2 = Number(series_2)
concat = Concatenate(FragmentA="Level_", FragmentB=num_2)

xy = XYPlane(Origin=Point(0, 0, 0))

crv = Curve(<curve referenced from the Rhino model>)

list = ValueList({"0", "1", "2", "3"}, selected=["0", "1"])
list_2 = ValueList({"PathA", "PathB"}, selected="PathB")
refbake = ReferenceByBakeName(BakeName="DirverLines_Straight", Key=list_2, Val=list, maintainStructure=False)

Z = UnitZ(Factor=Slider(28649, range=0..100000))
move = Move(Geometry=crv, Motion=Z)  # -> Geometry, Transform
rotate = Rotate(Geometry=move.Geometry, Angle=degrees(Slider(5, range=0..100)), Plane=PlaneXY(0, 0, 0))  # -> Geometry, Transform
Z_2 = UnitZ(Factor=Slider(53214, range=0..100000))
merge = Merge(Data1=crv, Data2=rotate.Geometry)
extr = Extrude(Base=rotate.Geometry, Direction=Z_2)
loft = Loft(Curves=merge, Options={Adjust=False, Closed=False, LoftEnds=0, LoftSimp=0, LoftType=0, Rebuild=10, Refit=0.01})
merge_2 = Merge(Data1=loft, Data2=extr)
join = BrepJoin(Breps=merge_2)  # -> Breps, Closed

list_3 = ValueList({"PathA", "PathB"}, selected="PathB")
list_4 = ValueList({"0", "1", "2", "3"}, selected=["2", "3"])
refbake_2 = ReferenceByBakeName(BakeName="DirverLines_Step", Key=list_3, Val=list_4, maintainStructure=False)

crv_2 = Curve(refbake)
lng = ListLength(List=crv_2)
division = Division(A=lng, B=Slider(20, range=0..100))
partition = PartitionList(List=crv_2, Size=division)
panel = Panel(partition)

pl_offset = PlaneOffset(BasePlane=xy, Offset=series)
pln = Plane(pl_offset)

panel_2 = Panel(series)
sec = BrepPlane(Brep=join.Breps, Plane=pln)  # -> Curves, Points

Z_3 = UnitZ(Factor=Slider(84934, range=0..100000))
extr_2 = Extrude(Base=crv, Direction=Z_3)

dam = DataDam(DataA=num, DataB=concat, BufferDelay=10000000, BufferMode=0)  # -> DataA, DataB

crv_3 = Curve(refbake_2)
Z_4 = UnitZ(Factor=Slider(4200, range=0..10000))
extr_3 = Extrude(Base=crv_3, Direction=Z_4)

levels = QueryLevels()
level = AddLevel(Elevation=dam.DataA, Name=dam.DataB)
delete = DeleteElement(Elements=levels)

crv_4 = Curve(refbake)
Z_5 = UnitZ(Factor=Slider(4200, range=0..10000))
extr_4 = Extrude(Base=crv_4, Direction=Z_5)

# ----
# Color Format
# Input
data = Data(1)
# Method
data_2 = Data(1)
# Output
data_3 = Data(1)
# Display
data_4 = Data(1)
# Unuse
data_5 = Data(1)

lng_2 = ListLength(List=partition)
data_6 = Data()
split = SplitList(List=partition, Index=expr("x-1", lng_2))  # -> ListA, ListB
shift = ShiftList(List=data_6, Shift="-1", Wrap=False)

preview = CustomPreview(Geometry=extr_2, Material=ColourSwatch(SwatchColor=RGBA(247, 136, 136, 177)))

preview_2 = CustomPreview(Geometry=extr_3, Material=ColourSwatch(SwatchColor=RGBA(0, 235, 247, 177)))

crv_5 = Curve(simplify(split.ListB))
levels_2 = QueryLevels(Name=concat)  # -> simplify(Levels)
crv_6 = Curve(simplify(split.ListA))
path_mapper = PathMapper(crv_5, source="{A;B}", target="{B}")

preview_3 = CustomPreview(Geometry=extr_4, Material=ColourSwatch(SwatchColor=RGB(136, 247, 160)))

panel_3 = Panel(split.ListB)

model = ModelCategoriesPicker({"HVAC ゾーン": -2008107, "MEP 製造用ダクト部品": -2008193, "MEP 製造用ハンガー部品": -2008203, "MEP 製造用収納部品": -2008212, "MEP 製造用配管部品": -2008208, "RVT リンク": -2001352, "エリア": -2003200, "カーテン グリッド": -2000173, "カーテン システム": -2000340, "カーテン パネル": -2000170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}, selected="壁": -2000011)
pshift = ShiftPaths(Data=crv_5, Offset=-2)  # -> simplify(Data)
elementtype_picker = ElementTypePicker(
    model,
    {"カーテンウォール : カーテンウォール": 22905, "カーテンウォール : ショーウィンドウ": 50936, "カーテンウォール : ファサードB_パネル_右": 210511, "カーテンウォール : ファサードB_標準": 208974, "カーテンウォール : ファサードB_窓_右": 211849, "カーテンウォール : 外部ガラス": 50935, "標準壁 : エクステリア - メタル スタッドのブロック": 75447, "標準壁 : 一般 - 150 mm": 219, "標準壁 : 一般 - 150 mm 組積造": 255, "標準壁 : 一般 - 200 mm": 249, "標準壁 : 一般 - 200 mm - 塗り潰し": 40342, "標準壁 : 一般 - 200 mm CMU": 254, "標準壁 : 一般 - 250 mm": 250, "標準壁 : 一般 - 300 mm": 251, "標準壁 : 一般 - 300 mm 組積造": 253, "標準壁 : 一般 - 375 mm": 252, "標準壁 : 一般 - 90 mm レンガ": 257, "標準壁 : 内壁 - 123 mm 間仕切り(1時間)": 261, "標準壁 : 内壁 - 126 mm 間仕切り(2時間)": 263, "標準壁 : 内壁 - 135 mm 間仕切り(2時間)": 262, "標準壁 : 内壁 - 138 mm 間仕切り(1時間)": 220, "標準壁 : 内壁 - 79 mm 間仕切り(1時間)": 258, "標準壁 : 基礎 - 300 mm コンクリート": 31000, "標準壁 : 外壁 - CMU のレンガ": 264, "標準壁 : 外壁 - メタル スタッドの EIFS": 256, "標準壁 : 外壁 - メタル スタッドのレンガ": 75445, "標準壁 : 外部 - ブロック上のレンガ、メタル スタッドで固定": 221, "標準壁 : 擁壁 - 300 mm コンクリート": 31001}, selected="カーテンウォール : ファサードB_パネル_右")
dam_2 = DataDam(DataA=path_mapper, DataB=elementtype_picker, DataC=levels_2, BufferDelay=10000000, BufferMode=0)  # -> DataA, DataB, DataC
wall = AddWall(Curve=dam_2.DataA, Type=dam_2.DataB, Level=dam_2.DataC)

crv_7 = Curve(sec.Curves)
path_mapper_2 = PathMapper(crv_6, source="{A;B}", target="{B}")

model_2 = ModelCategoriesPicker({"HVAC ゾーン": -2008107, "MEP 製造用ダクト部品": -2008193, "MEP 製造用ハンガー部品": -2008203, "MEP 製造用収納部品": -2008212, "MEP 製造用配管部品": -2008208, "RVT リンク": -2001352, "エリア": -2003200, "カーテン グリッド": -2000173, "カーテン システム": -2000340, "カーテン パネル": -2000170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}, selected="壁": -2000011)
elementtype_picker_2 = ElementTypePicker(
    model_2,
    {"カーテンウォール : カーテンウォール": 22905, "カーテンウォール : ショーウィンドウ": 50936, "カーテンウォール : ファサードB_パネル_右": 210511, "カーテンウォール : ファサードB_標準": 208974, "カーテンウォール : ファサードB_窓_右": 211849, "カーテンウォール : 外部ガラス": 50935, "標準壁 : エクステリア - メタル スタッドのブロック": 75447, "標準壁 : 一般 - 150 mm": 219, "標準壁 : 一般 - 150 mm 組積造": 255, "標準壁 : 一般 - 200 mm": 249, "標準壁 : 一般 - 200 mm - 塗り潰し": 40342, "標準壁 : 一般 - 200 mm CMU": 254, "標準壁 : 一般 - 250 mm": 250, "標準壁 : 一般 - 300 mm": 251, "標準壁 : 一般 - 300 mm 組積造": 253, "標準壁 : 一般 - 375 mm": 252, "標準壁 : 一般 - 90 mm レンガ": 257, "標準壁 : 内壁 - 123 mm 間仕切り(1時間)": 261, "標準壁 : 内壁 - 126 mm 間仕切り(2時間)": 263, "標準壁 : 内壁 - 135 mm 間仕切り(2時間)": 262, "標準壁 : 内壁 - 138 mm 間仕切り(1時間)": 220, "標準壁 : 内壁 - 79 mm 間仕切り(1時間)": 258, "標準壁 : 基礎 - 300 mm コンクリート": 31000, "標準壁 : 外壁 - CMU のレンガ": 264, "標準壁 : 外壁 - メタル スタッドの EIFS": 256, "標準壁 : 外壁 - メタル スタッドのレンガ": 75445, "標準壁 : 外部 - ブロック上のレンガ、メタル スタッドで固定": 221, "標準壁 : 擁壁 - 300 mm コンクリート": 31001}, selected="カーテンウォール : ファサードB_標準")
dam_3 = DataDam(DataA=path_mapper_2, DataB=elementtype_picker_2, DataC=levels_2, BufferDelay=10000000, BufferMode=0)  # -> DataA, DataB, DataC
wall_2 = AddWall(Curve=dam_3.DataA, Type=dam_3.DataB, Level=dam_3.DataC)

item = ListItem(List=flatten(crv_7), Index=0, Wrap=True)
flip = FlipCurve(Curve=crv_7, Guide=item)  # -> Curve, Flag

neg = Negative(Value=Slider(5000, range=0..10000))
offset = OffsetCurve(Curve=flip.Curve, Distance=neg, Plane=PlaneXY(0, 0, 0), Corners=1)
explode = Explode(Curve=offset, Recursive=True)  # -> Segments, Vertices
len = Length(Curve=explode.Segments)
division_2 = Division(A=len, B="5000")
divide = DivideCurve(Curve=explode.Segments, Count=division_2, Kinks=False)  # -> simplify(Points), Tangents, Parameters

relitem = RelativeItem(Tree=divide.Points, Offset="{1;0}", WrapPaths=False, WrapItems=False)  # -> ItemA, ItemB
ln = Line(StartPoint=relitem.ItemA, EndPoint=relitem.ItemB)
panel_4 = Panel(path_mapper)
keysearch = KeyValueSearch()

simplify = SimplifyCurve(Curve=flip.Curve)  # -> Curve, Simplified
explode_2 = Explode(Curve=simplify.Curve, Recursive=True)  # -> Segments, Vertices

item_2 = ListItem(List=flatten(simplify.Curve), Index=0, Wrap=True)

midpt = CurveMiddle(Curve=explode_2.Segments)
alongcrv = SortAlongCurve(Points=midpt, Curve=item_2)  # -> Points, Indices
item_3 = ListItem(List=explode_2.Segments, Index=alongcrv.Indices, Wrap=True)
crv_8 = Curve(item_3)

len_2 = Length(Curve=crv_8)
division_3 = Division(A=len_2, B="3000")
divide_2 = DivideCurve(Curve=crv_8, Count=division_3, Kinks=False)  # -> Points, Tangents, simplify(Parameters)

item_4 = ListItem(List=crv_8, Index=0, Wrap=True)  # -> Item, Item1, Item2, Item3
crv_9 = Curve(crv_8)

num_3 = Number(divide_2.Parameters)

graft = GraftTree(Tree=crv_8, IncludeEmptyLists=True, IncludeNullItems=True)  # -> simplify(Tree)
shatter = Shatter(Curve=graft, Parameters=divide_2.Parameters)

pshift_2 = ShiftPaths(Data=num_3, Offset=-1)
tstat = TreeStatistics(Tree=pshift_2)  # -> Paths, Length, Count
series_3 = Series(Start=0, Step=1, Count=tstat.Count)

crv_10 = Curve(simplify(shatter))
tstat_2 = TreeStatistics(Tree=crv_10)  # -> Paths, Length, Count
dpath = DeconstructPath(Branch=tstat_2.Paths)
item_5 = ListItem(List=dpath, Index=0, Wrap=True)  # -> Item, Item1
merge_3 = Merge(Data1=item_5.Item, Data2=item_5.Item1)

lng_3 = ListLength(List=pshift_2)
mod = Modulus(A=series_3, B="2")  # -> graft(Result)
repeat = RepeatData(Data=mod, Length=lng_3)
unflatten = UnflattenTree(Tree=repeat, Guide=num_3)

merge_4 = Merge(Data1=Toggle(False), Data2=Toggle(True))
bool = Boolean(invert(merge_4))
bool_2 = Boolean(merge_4)
lng_4 = ListLength(List=unflatten)
repeat_2 = RepeatData(Data=bool_2, Length=lng_4)
repeat_3 = RepeatData(Data=bool, Length=lng_4)

panel_5 = Panel(merge_3)
panel_6 = Panel("""PathA
PathB""")
attributes = DefineObjectAttributes(
    UserKeys=panel_6,
    UserValues=panel_5,
    Name="DirverLines_Straight",
    Layer="DirverLines_Straight",
    Color=ColourSwatch(SwatchColor=RGB(25, 173, 227)))
bake = BakeObjects(Geometry=crv_10, Attributes=attributes, BakeName="DirverLines_Straight", Bake=False)

p_n_c = PickNChoose(Pattern=unflatten, Stream0=repeat_2, Stream1=repeat_3)
cull = CullPattern(List=num_3, CullPattern=p_n_c)

shatter_2 = Shatter(Curve=graft(crv_9), Parameters=cull)
item_6 = ListItem(List=shatter_2, Index=0, Wrap=True)

crv_11 = Curve(simplify(shatter_2))
tstat_3 = TreeStatistics(Tree=crv_11)  # -> Paths, Length, Count
dpath_2 = DeconstructPath(Branch=tstat_3.Paths)
item_7 = ListItem(List=dpath_2, Index=0, Wrap=True)  # -> Item, Item1
merge_5 = Merge(Data1=item_7.Item, Data2=item_7.Item1)

panel_7 = Panel(merge_5)
panel_8 = Panel("""PathA
PathB""")
attributes_2 = DefineObjectAttributes(
    UserKeys=panel_8,
    UserValues=panel_7,
    Name="DirverLines_Step",
    Layer="DirverLines_Step",
    Color=ColourSwatch(SwatchColor=RGB(25, 173, 227)))
bake_2 = BakeObjects(Geometry=crv_11, Attributes=attributes_2, BakeName="DirverLines_Step", Bake=False)
